# Grasshopper definition export_to_file.gh (Grasshopper 0.9.76)

mesh = Mesh(<mesh referenced from the Rhino model>)
path = FilePath("C:\Users\confusionthewaitress\Google Drive\MetaLAB\BBM\BookBio\Development\Scripts\public\models\surf.json")
c_script = CSharpScript(m=mesh, name="mapbase", path=path)  # -> out, A, B, C, D, E; inputs m: Mesh, name: String, path: String
# ---------- c_script: C# ----------
    m.Faces.ConvertQuadsToTriangles();
    m.FaceNormals.ComputeFaceNormals();
    m.Normals.ComputeNormals();

    List<double> Zs = new List<double>();
    List<double> NX = new List<double>();
    List<double> NY = new List<double>();
    List<double> NZ = new List<double>();

    string fname = System.IO.Path.GetDirectoryName(path);
    fname += @"\" + name + ".json";

    System.IO.StreamWriter w = new System.IO.StreamWriter(fname);

    w.Write("{\"VBO\":[\n");
    //string data = "TempVBOdata=new Float32Array([\n";
    for (int i = 0; i < m.Vertices.Count; ++i) {
      if (i != 0) w.Write(",");
      w.Write(m.Vertices[i].X.ToString() + "," +
        m.Vertices[i].Y.ToString() + "," +
        m.Vertices[i].Z.ToString() + "," +
        m.Normals[i].X.ToString() + "," +
        m.Normals[i].Y.ToString() + "," +
        m.Normals[i].Z.ToString() + ",");


      if(m.Vertices[i].Z != 0.0) Zs.Add(m.Vertices[i].Z);
      if(m.Normals[i].X != 0.0) NX.Add(m.Normals[i].X);
      if(m.Normals[i].Y != 0.0) NY.Add(m.Normals[i].Y);
      if(m.Normals[i].Z != -1.0) NZ.Add(m.Normals[i].Z);

      if (m.TextureCoordinates.Count != 0) {
        w.Write(m.TextureCoordinates[i].X + "," + m.TextureCoordinates[i].Y);
      }
      else w.Write("0,0");
    }
    w.Write("],\n");

    w.Write("\"IBO\":[\n");
    for (int i = 0; i < m.Faces.Count; ++i) {
      if (i != 0) w.Write(",");
      w.Write(m.Faces[i].A + "," + m.Faces[i].B + "," + m.Faces[i].C);
    }
    w.Write("]\n}");


    w.Close();

    B = Zs;
    C = NX;
    D = NY;
    E = NZ;
# ---------- end c_script ----------
panel = Panel(c_script.A)
